# Dynamo graph 01.1_DynamoPlayer_End.dyn (Dynamo 1.3.2.2480)

# group: Dynamo Workshop- Copy Filters between View Templates.
# note: </Title>
# note: <Title>

# group: Annotation
# note: For notes and titles

# group: To Revit
# note: For changes made to Revit

# group: Control
# note: For sliders and other options

# group: Input
# note: For selection and whatnot

# group: Background
# note: For workflow

# group: Host View Template
view_template_to_get_filters = ViewTemplatesUi("Architectural Section")  # "View Template to Get Filters From"

# group: Child View Template
view_template_to_send_filters_to = ViewTemplatesUi("Architectural Plan")

# group: Get the filters and overrides
filters = View.Filters(view_template_to_send_filters_to)
filterOverrides = View.FilterOverrides(view_template_to_send_filters_to, filters)

# group: Add filter to view
addFilter = View.AddFilter(view_template_to_get_filters, filters)

# group: Set the overrides
code_block = CodeBlock { true; }
setFilterOverrides = View.SetFilterOverrides(view=addFilter, parameterFilter=filters, overrides=filterOverrides, hide=code_block)
