# Dynamo graph 02.3_CustomPackages_Begin.dyn (Dynamo 1.3.2.2480)

python_script = Python()  # unwired: IN[0], IN[1]
# ---------- python_script.python (17 lines) ----------
import clr

clr.AddReference('RevitAPI')
from Autodesk.Revit.DB import *

clr.AddReference("RevitServices")
import RevitServices
from RevitServices.Persistence import DocumentManager
from RevitServices.Transactions import TransactionManager

doc = DocumentManager.Instance.CurrentDBDocument

TransactionManager.Instance.EnsureInTransaction(doc)
#your command goes here
TransactionManager.Instance.TransactionTaskDone()

OUT = []
# ----------------------------------------
