# Dynamo graph 04.1_DataVisualization_End.dyn (Dynamo 1.3.1.1736)

# group: INPUT
# note: INPUT
# note: USE:
# FOR THE USER INPUT (SUCH AS SLIDERS,
#  NUMBERS, CODE BLOCKS....)

# group: DESIGN
# note: DESIGN
# note: USE:
# FOR THE BACK-END FUNCTIONALITY

# group: OUTPUT
# note: INPUT
# note: USE:
# FOR THE GRAPH OUTPUTS (SUCH AS CSV'S, CHARTS....)

# group: Get Rooms, Room Name, Number, and Area
categories = Categories("Rooms")
all_elements_of_category = ElementsOfCategory(categories)
name = Room.Name(all_elements_of_category)
area = Room.Area(all_elements_of_category)

# group: Grab Max and Min Areas to set Domain
minimumItem = List.MinimumItem(area)
maximumItem = List.MaximumItem(area)
domain = Charts.MiscNodes.Domain(minimumItem, maximumItem)

code_block = CodeBlock { Color.ByARGB(1, 105, 244, 189); }
margins_size = IntegerSlider(100, range=0..100 step 1)

# group: Creating Margins around Chart
margins = Charts.MiscNodes.Margins(margins_size, margins_size, margins_size, margins_size)

code_block_2 = CodeBlock { "Area"; }

# group: Setting X-axis Properties
count = Count(all_elements_of_category)
code_block_3 = CodeBlock { 90; }

# group: Create a Bar Chart with Data and Style Inputs
data = Charts.BarChart.Data(name, area, domain)
style = Charts.BarChart.Style(code_block, arg3=margins, arg6=code_block_2, arg7=count, arg8=code_block_3)
chart = Charts.BarChart.Chart(data, style)

# group: Create Reports
create_report = MandrillReportNode(chart)
report_window = MandrillWindowNodeModel(create_report)
