# Dynamo graph 04.4_DataVisualization_Begin.dyn (Dynamo 1.3.1.1736)

# group: INPUT
# note: INPUT
# note: USE:
# FOR THE USER INPUT (SUCH AS SLIDERS,
#  NUMBERS, CODE BLOCKS....)

# group: DESIGN
# note: DESIGN
# note: USE:
# FOR THE BACK-END FUNCTIONALITY

# group: OUTPUT
# note: OUTPUT
# note: USE:
# FOR THE GRAPH OUTPUTS (SUCH AS CSV'S, CHARTS....)

file_path = Filename("No file selected.")

# group: Collect Rooms
categories = Categories("Rooms")
all_elements_of_category = ElementsOfCategory(categories)

number_of_rooms_to_analyze = CodeBlock { 10; }

# group: Grab 10 Rooms and the Walls bounding these Rooms
categories_2 = Categories("Walls")
all_elements_of_category_2 = ElementsOfCategory(categories_2)
code_block = CodeBlock { 0.25; }
getSurroundingElements = Custom[Tool.GetSurroundingElements](Element=all_elements_of_category, ElementCheck=all_elements_of_category_2, Tolerance=code_block)  # Get Surrounding Elements by Categories, group them as List. Tolerance distance available.
takeItems = List.TakeItems(list=getSurroundingElements, amount=number_of_rooms_to_analyze)
code_block_2 = CodeBlock { 1; }

# group: Grab Cooresponding Rooms
takeItems_2 = List.TakeItems(list=takeItems@L2, amount=code_block_2)

# group: Grab Wall Materials and Group by Room
dropItems = List.DropItems(list=takeItems@L2, amount=code_block_2)
type = Archilab.Grimshaw.Elements.Element.Type(dropItems)
compoundStructureLayers = Custom[FamilyType.CompoundStructureLayers](elementType=type)  # Retrieves the compound layers of any layered family type (wall types, roof types, floor types etc.)
count = Count(type@L2)
chop = List.Chop(list=compoundStructureLayers.materials, lengths=count)
name = Element.Name(chop)
flatten = Flatten(name@L3)
uniqueItems = List.UniqueItems(flatten@L2)
clear_list = Custom[Clear List](Input=uniqueItems)  # This node will remove all Null and Empty Lists from any list.

# group: Format Data for Power BI
count_2 = Count(clear_list@L2)
cycle = List.Cycle(list=takeItems_2, amount=count_2, lacing=Longest)
code_block_3 = CodeBlock(in1=cycle, in2=clear_list) { Transpose({in1.Name, in2}); }
transpose = List.Transpose(code_block_3@L3)
flatten_2 = Flatten(transpose@L2)

writeToFile = CSV.WriteToFile(file_path, flatten_2)
