# Dynamo graph 03_ListEfficiency_End.dyn (Dynamo 1.3.1.1736)

# group: INPUT
# note: USE:
# FOR THE USER INPUT (SUCH AS SLIDERS,
#  NUMBERS, CODE BLOCKS....)
# note: INPUT

# group: OUTPUT
# note: USE:
# FOR THE GRAPH OUTPUTS (SUCH AS PLACED COMPONENTS, GEOMETRY PREVIEWS....)
# note: OUTPUT

# group: DESIGN
# note: DESIGN
# note: USE:
# FOR THE BACK-END FUNCTIONALITY

# group: Select Face to Start Designing
select_face = DSFaceSelection()  # 1 picked in the model

number_of_rectangles = IntegerSlider(5, range=2..6 step 1)

# group: Create a list of parameter values to get lines on the selected face
code_block = CodeBlock(numberOfRectangles=number_of_rectangles) { 0..1..#numberOfRectangles+1; }

# group: Visualizing the Rectangles
code_block_2 = CodeBlock { {0,1}; }
getIsoline = Surface.GetIsoline(select_face, code_block_2, code_block, lacing=CrossProduct)

# group: Creating All Rectangle Corner points
pointAtParameter = Surface.PointAtParameter(surface=select_face, u=code_block, v=code_block, lacing=CrossProduct)

# group: Group Points by Quad
code_block_3 = CodeBlock(numberOfRectangles=code_block) { 0..Count(numberOfRectangles)-2..1; }
code_block_4 = CodeBlock(item=code_block_3) { item+1; }
create = List.Create(code_block_3, code_block_4)
transpose = List.Transpose(create)
getItemAtIndex = List.GetItemAtIndex(list=pointAtParameter@L2, index=transpose)
getItemAtIndex_2 = List.GetItemAtIndex(list=getItemAtIndex@L3, index=code_block_3, lacing=CrossProduct)
transpose_2 = List.Transpose(getItemAtIndex_2)
getItemAtIndex_3 = List.GetItemAtIndex(list=transpose_2@L3, index=transpose)
flatten = Flatten(getItemAtIndex_3@L3)

# group: May need to Reorder Points based on Adaptive Component Creation
code_block_5 = CodeBlock { {0, 1, 2, 3}; }
reorder = Reorder(flatten, code_block_5)

# group: Select Adaptive Component to Place
family_types = FamilyTypes("Simple Panel:Simple Panel")

byPoints = AdaptiveComponent.ByPoints(points=reorder, familyType=family_types)  # frozen
