# Dynamo graph 05.4_Animation_End.dyn (Dynamo 1.3.2.2480)

# group: Dynamo Workshop- Wave Animation
# note: </Title>
# note: <Title>

# group: Annotation
# note: For notes and titles

# group: Output
# note: For changes made to Revit

# group: Control
# note: For sliders and other options

# group: Input
# note: For selection and whatnot

# group: Background
# note: For workflow

# group: Build rectangles to extrude
code_block = CodeBlock { 0..100..5; }
byCoordinates = Point.ByCoordinates(x=code_block)
byOriginNormal = Plane.ByOriginNormal(origin=byCoordinates)
code_block_2 = CodeBlock { 3; }
byWidthLength = Rectangle.ByWidthLength(plane=byOriginNormal, width=code_block_2, length=code_block_2)

# group: Build the range and reverse it, then join back into one list
count = Count(byWidthLength)
code_block_3 = CodeBlock(bars=count) { 5..100..#bars; }
code_block_4 = CodeBlock { 10; }
takeItems = List.TakeItems(list=code_block_3, amount=code_block_4)
reverse = List.Reverse(takeItems)
join = List.Join(takeItems, reverse)

# group: Periodically changed the indice to trigger the wave action
code_block_5 = CodeBlock { 0; 20; 5000; }
# note: Firefly
faderOneWay = Firefly.Utility.FaderOneWay(code_block_5.out0, code_block_5.out1, code_block_5.out2)

# group: Gives the "Wave" effect
shiftIndices = List.ShiftIndices(list=join, amount=faderOneWay)

# group: Build a color range with the applicable amount of colors.
color_picker = nColorPicker()
color_picker_2 = nColorPicker()
create = List.Create(color_picker, color_picker_2)
code_block_6 = CodeBlock(bars=count) { 0..1..#bars; }
color_range = ColorRange(create, arg2=code_block_6)  # unwired: arg1

# group: Extrudes them and colors accordingly.
extrudeAsSolid = Curve.ExtrudeAsSolid(byWidthLength, shiftIndices)
byGeometryColor = Display.Display.ByGeometryColor(extrudeAsSolid, color_range)
