# Dynamo graph 06_5 Level Building_End.dyn (Dynamo 1.3.1.1736)

# group: DESIGN
# note: USE:
# FOR THE BACK-END FUNCTIONALITY
# note: DESIGN

# group: INPUT
# note: INPUT
# note: USE:
# FOR THE USER INPUT (SUCH AS SLIDERS, NUMBERS, CODE BLOCKS...)

# group: OUTPUT
# note: OUTPUT
# note: USE:
# FOR THE GRAPH OUTPUTS (SUCH AS GENERATED GEOMETRY, PREVIEWS,....)

# group: Set Level Elevations
origin = Point.Origin()
ZAxis = Vector.ZAxis()
number_of_levels = IntegerSlider(10, range=5..10 step 1)
code_block = CodeBlock(numberOfLevels=number_of_levels) { (0..numberOfLevels..1)*10; }
scale = Vector.Scale(vector=ZAxis, scale_factor=code_block, lacing=Longest)
add = Point.Add(point=origin, vectorToAdd=scale)

# group: Use Planes to Create Rectangles
ZAxis_2 = Vector.ZAxis()
byOriginNormal = Plane.ByOriginNormal(origin=add, normal=ZAxis_2, lacing=Longest)
code_block_2 = CodeBlock(item=byOriginNormal) { item[0]; item[1]; item[2]; item[3]; item[4]; }

# group: Create Rectangles that define Level 1 and Level 2
level_2_width_height = IntegerSlider(20, range=20..40 step 5)
byWidthLength = Rectangle.ByWidthLength(plane=code_block_2.out1, width=level_2_width_height, length=level_2_width_height)
level_1_width_height = IntegerSlider(20, range=20..40 step 5)
byWidthLength_2 = Rectangle.ByWidthLength(plane=code_block_2.out0, width=level_1_width_height, length=level_1_width_height)

# group: Create other 5 Levels
integer_slider = IntegerSlider(20, range=20..40 step 5)
integer_slider_2 = IntegerSlider(20, range=20..40 step 5)
byWidthLength_3 = Rectangle.ByWidthLength(plane=code_block_2.out2, width=integer_slider, length=integer_slider_2)
integer_slider_3 = IntegerSlider(20, range=20..40 step 5)
integer_slider_4 = IntegerSlider(20, range=20..40 step 5)
byWidthLength_4 = Rectangle.ByWidthLength(plane=code_block_2.out3, width=integer_slider_3, length=integer_slider_4)
integer_slider_5 = IntegerSlider(20, range=20..40 step 5)
integer_slider_6 = IntegerSlider(20, range=20..40 step 5)
byWidthLength_5 = Rectangle.ByWidthLength(plane=code_block_2.out4, width=integer_slider_5, length=integer_slider_6)

# group: Loft Together the top Rectangles
create = List.Create(byWidthLength, byWidthLength_3, byWidthLength_4, byWidthLength_5)
byLoft = Solid.ByLoft(create)

# group: Create Guide Curves between Corresponding Corners of Rectangles
create_2 = List.Create(byWidthLength_2, byWidthLength)
corners = Polygon.Corners(byWidthLength_2)
corners_2 = Polygon.Corners(byWidthLength)
create_3 = List.Create(corners, corners_2)
transpose = List.Transpose(create_3)
firstItem = List.FirstItem(transpose@L2)
lastItem = List.LastItem(transpose@L2)
byStartPointEndPoint = Line.ByStartPointEndPoint(startPoint=firstItem, endPoint=lastItem)
create_4 = List.Create(byWidthLength, byWidthLength_3)
corners_3 = Polygon.Corners(byWidthLength_3)
create_5 = List.Create(corners_2, corners_3)
transpose_2 = List.Transpose(create_5)
firstItem_2 = List.FirstItem(transpose_2@L2)
lastItem_2 = List.LastItem(transpose_2@L2)
byStartPointEndPoint_2 = Line.ByStartPointEndPoint(startPoint=firstItem_2, endPoint=lastItem_2)

# group: Loft Together Bottom Rectangles
byLoft_2 = Solid.ByLoft(create_2, byStartPointEndPoint)
byLoft_3 = Solid.ByLoft(create_4, byStartPointEndPoint_2)

# group: Calculate and Show Areas of First Two Levels
create_6 = List.Create(byLoft, byLoft_2, byLoft_3)
flatten = Flatten(create_6)
byUnion = Solid.ByUnion(flatten)
intersect = Geometry.Intersect(geometry=byUnion, other=byOriginNormal)
flatten_2 = Flatten(intersect)
area = Surface.Area(flatten_2@L2)
code_block_3 = CodeBlock(item=area) { item[0]; item[1]; item[2]; item[3]; item[4]; }

# group: Area of First Two Levels
level_1_area = Watch(code_block_3.out0)
level_2_area = Watch(code_block_3.out1)

# group: Site Rectangle
origin_2 = Point.Origin()
byOriginNormal_2 = Plane.ByOriginNormal(origin=origin_2, normal=ZAxis_2, lacing=Longest)
site_width_height = IntegerSlider(60, range=20..60 step 5)
byWidthLength_6 = Rectangle.ByWidthLength(plane=byOriginNormal_2, width=site_width_height, length=site_width_height)

# group: Rotate Building on Site
byOriginNormal_3 = Plane.ByOriginNormal(origin=origin)
rotation_on_site = IntegerSlider(0, range=0..90 step 5)
rotate = Geometry.Rotate(intersect, byOriginNormal_3, rotation_on_site)
create_7 = List.Create(byLoft_2, byLoft_3, byLoft)
byUnion_2 = Solid.ByUnion(create_7)
rotate_2 = Geometry.Rotate(byUnion_2, byOriginNormal_3, rotation_on_site)

# group: Calculate Exterior Surface Area
explode = Geometry.Explode(rotate_2)
area_2 = Surface.Area(explode)
sum = Math.Sum(area_2)
surface_area_of_exterior = Watch(sum)
