# Dynamo graph 01.3_DynamoPlayer_End.dyn (Dynamo 1.3.3.4651)

# group: Dynamo Workshop- Merge Dimensions
# note: </Title>
# note: <Title>

# group: Annotation
# note: For notes and titles

# group: To Revit
# note: For changes made to Revit

# group: Control
# note: For sliders and other options

# group: Input
# note: For selection and whatnot

# group: Background
# note: For workflow

# group: Popup window information
file_path = Filename("D:\OneDrive\EvolveLAB Transfer\EvolveLAB\Presentations\AU2017\Dynamo BIM Workshop\Dataset\01_DynamoPlayer\Resources\AU-Logo.png")
code_block = CodeBlock { "Merge Several Dimensions into One"; }
code_block_2 = CodeBlock { "merge 'em"; }
code_block_3 = CodeBlock { true; "never mind"; }

# group: Description text
string = StringInput("Your face when you realized a user used several single dimension strings.")
ui_textnote_data = Custom[UI.TextNote Data](TextNote=string)  # Create Data for TextNote input in UI.MultipleInputForm ++ . Check out www.data-shapes.net for more informations

# group: Displays our awesome image
file_path_2 = Filename("D:\OneDrive\EvolveLAB Transfer\EvolveLAB\Presentations\AU2017\Dynamo BIM Workshop\Dataset\01_DynamoPlayer\Resources\reaction.gif")
code_block_4 = CodeBlock { false; }
ui_image_data = Custom[UI.Image Data](Image=file_path_2, ShowBorder_optional=code_block_4)  # Places an image on UI.MultipleInutForm ++ .

# group: Creates an isolated selection of dimensions
code_block_5 = CodeBlock { "Let's fix that"; "Select single dimensions"; }
categories = Categories("Dimensions")
ui_selectmodelelements_data = Custom[UI.SelectModelElements Data](InputName=code_block_5.out0, ButtonText=code_block_5.out1, CategoryFilter=categories)  # Creates a Revit element selection input for UI.MultipleInputForm++ . Check out www.data-shapes.net for more infos!

create = List.Create(ui_textnote_data, ui_image_data, ui_selectmodelelements_data)

# group: Displays popup and obtains the selected dimensions.
ui_multipleinputform = Custom[UI.MultipleInputForm ++](Description_optional=code_block, Logo_optional=file_path, ButtonText_optional=code_block_2, Inputs=create, Toggle=code_block_3.out0, CancelButtonText_optional=code_block_3.out1)  # Create a form with multiple inputs. see www.data-shapes.net for tutorials and infos!
code_block_6 = CodeBlock(dimension=ui_multipleinputform.User_Inputs) { dimension[0]; }

# group: Get the current view from the file
current = Document.Current()
activeView = Document.ActiveView(current)

# group: Obtains the dimensioned elements and remove duplicates
# note: Rhythm
getReferenceElements = Rhythm.Revit.Elements.Dimension.GetReferenceElements(code_block_6)
flatten = Flatten(getReferenceElements)
uniqueItems = List.UniqueItems(flatten)

# group: Gets the underlying curve of the dimensions, finds the first start point and the last end point. Then create a line for the dimension to be created at.
# note: Rhythm
getCurve = Rhythm.Revit.Elements.Dimension.GetCurve(code_block_6)
deconstruct = List.Deconstruct(list=getCurve)
startPoint = Curve.StartPoint(deconstruct.first)
lastItem = List.LastItem(deconstruct.rest)
endPoint = Curve.EndPoint(lastItem)
byStartPointEndPoint = Line.ByStartPointEndPoint(startPoint=startPoint, endPoint=endPoint)

# group: Create the new dimension
byElements = Dimension.ByElements(activeView, uniqueItems, byStartPointEndPoint)

# group: Delete the old ones after the new one is created
passthrough = Custom[Passthrough](passThrough=code_block_6, waitFor=byElements)  # Forces a sequential order of execution. The node wired into the output of the Passthrough node will be executed *after* the node wired into the waitFor input (e.g. important for some Revit operations). The value of the passThrough input will be passed on to the node wired into the output port of the Passthrough node.
code_block_7 = CodeBlock { true; }
deleteElements = Custom[Springs.Doc.DeleteElements](element=passthrough, confirm=code_block_7)  # Attempts to delete the input list of elements from the active Revit document.The node returns the number of successfully deleted elements and their Ids as a string. Carefully observe the deleted elements count. It may be greater than the input list because hosted elements or tags will be deleted as well. If an element in the list can not be deleted (for example last revision or last view), the whole list will fail to be deleted.

# group: Inputs for result window
code_block_8 = CodeBlock { "awesome"; }
code_block_9 = CodeBlock(amount=deleteElements.count) { amount + " dimensions have been merged! Nice Job!"; }
ui_textnote_data_2 = Custom[UI.TextNote Data](TextNote=code_block_9)
file_path_3 = Filename("Resources\reaction-fixed.gif")
code_block_10 = CodeBlock { false; }
ui_image_data_2 = Custom[UI.Image Data](Image=file_path_3, ShowBorder_optional=code_block_10)
create_2 = List.Create(ui_textnote_data_2, ui_image_data_2)
code_block_11 = CodeBlock { true; }

ui_multipleinputform_2 = Custom[UI.MultipleInputForm ++](Logo_optional=file_path, ButtonText_optional=code_block_8, Inputs=create_2, Toggle=code_block_11)
