# Dynamo graph 02.1_ListEfficiency_End.dyn (Dynamo 1.3.2.2480)

# group: Dynamo Workshop List Efficiency
# note: </Title>
# note: <Title>

# group: To Revit
# note: For changes made to Revit

# group: Annotation
# note: For notes and titles

# group: Control
# note: For sliders and other options

# group: Input
# note: For selection and whatnot

# group: Background
# note: For workflow

# group: Collects all rooms in model
categories = Categories("Walls")
all_elements_of_category = ElementsOfCategory(categories)

# group: Filters out unplaced and unbounded rooms
code_block = CodeBlock { "Angle"; ""; }
getParameterValueByName = Element.GetParameterValueByName(element=all_elements_of_category, parameterName=code_block.out0)
ne = getParameterValueByName != code_block.out1
# note: in = curtain walls
filterByBoolMask = List.FilterByBoolMask(list=all_elements_of_category, mask=ne)

panels = Custom[Element.Panels](hostElement=filterByBoolMask.in)  # Retrieves the panels nested in a curtain wall, curtain system or glazed roof. Differences to OOTB node CurtainPanel.ByElement: - Returns embedded walls - Panels of curtain systems and glazed roofs are returned in a nested list, with one sublist for each face of the curtain system. PLEASE NOTE: Will not work for glazed roofs created by RoofByFace method.
