# Dynamo graph 02.2_ListEfficiency_End.dyn (Dynamo 1.3.2.2480)

# group: Dynamo Workshop List Efficiency
# note: </Title>
# note: <Title>

# group: To Revit
# note: For changes made to Revit

# group: Annotation
# note: For notes and titles

# group: Control
# note: For sliders and other options

# group: Input
# note: For selection and whatnot

# group: Background
# note: For workflow

# group: Collects all rooms in model
categories = Categories("Rooms")
all_elements_of_category = ElementsOfCategory(categories)

# group: Filters out unplaced and unbounded rooms
code_block = CodeBlock { "Area"; ""; }
getParameterValueByName = Element.GetParameterValueByName(element=all_elements_of_category, parameterName=code_block.out0)
ne = getParameterValueByName != code_block.out1
filterByBoolMask = List.FilterByBoolMask(list=all_elements_of_category, mask=ne)

# group: Group rooms by level
code_block_2 = CodeBlock { "Level"; }
getParameterValueByName_2 = Element.GetParameterValueByName(element=filterByBoolMask.in, parameterName=code_block_2)
groupByKey = List.GroupByKey(list=filterByBoolMask.in, keys=getParameterValueByName_2)

# group: Get ALL the boundaries of the rooms
finishBoundary = Room.FinishBoundary(groupByKey.groups)

# group: Obtain the outer curves of the rooms and form a polycurve
firstItem = List.FirstItem(finishBoundary@L3)  # frozen
byJoinedCurves = PolyCurve.ByJoinedCurves(firstItem)

# group: The first item of the list (level1)
code_block_3 = CodeBlock { 0; }
getItemAtIndex = List.GetItemAtIndex(list=finishBoundary, index=code_block_3)

deconstruct = List.Deconstruct(list=getItemAtIndex@L3)
byJoinedCurves_2 = PolyCurve.ByJoinedCurves(deconstruct.first)
extrudeAsSolid = Curve.ExtrudeAsSolid(byJoinedCurves_2)
