# Dynamo graph 04.2_CustomPackages_End.dyn (Dynamo 1.3.3.4651)

# group: Area location of Elements
# note: </Title>
# note: <Title>

# group: To Revit
# note: For changes made to Revit

# group: Annotation
# note: For notes and titles

# group: Control
# note: For sliders and other options

# group: Input
# note: For selection and whatnot

# group: Background
# note: For workflow

categories = Categories("Areas")
all_elements_of_category = ElementsOfCategory(categories)
view_type = ViewTypesUi("AreaPlan")
getByType = archilab.Revit.Views.Views.GetByType(view_type)

# group: Build an area lookup dictionary
python_script = Python(IN[0]=getByType)
# ---------- python_script.python (35 lines) ----------
import clr
clr.AddReference('ProtoGeometry')
from Autodesk.DesignScript.Geometry import *

# Import DocumentManager and TransactionManager
clr.AddReference("RevitServices")
import RevitServices
from RevitServices.Persistence import DocumentManager
from RevitServices.Transactions import TransactionManager

# Import RevitAPI
clr.AddReference("RevitAPI")
import Autodesk
from Autodesk.Revit.DB import *

doc = DocumentManager.Instance.CurrentDBDocument
uiapp = DocumentManager.Instance.CurrentUIApplication
app = uiapp.Application

from System.Collections.Generic import *

#Custom tolist definition provided by Dimitar Venkov
#https://github.com/dimven/SpringNodes
def tolist(x):
	if hasattr(x,'__iter__'): return x
	else : return [x]

elements = tolist(UnwrapElement(IN[0]))
levelId = []
for i in elements:
	levelId.append(i.GenLevel)



OUT = levelId
# ----------------------------------------
id = Element.Id(python_script)
code_block = CodeBlock(areaLevelIds=getByType, areas=id) { areaDictionary = {}; areaDictionary[areaLevelIds] = areas; }

level = Custom[Element.Level](element=all_elements_of_category)  # Gets an element's level
id_2 = Element.Id(level)

# group: Get the area's host view given the level id
code_block_2 = CodeBlock(areaDic=code_block.areaDictionary, key=id_2) { areaDic[key]; }

# group: Custom Bounding Box Definition
python_script_2 = Python(IN[0]=all_elements_of_category, IN[1]=code_block_2)  # frozen
# ---------- python_script_2.python (41 lines) ----------
import clr
clr.AddReference('ProtoGeometry')
from Autodesk.DesignScript.Geometry import *

# Import DocumentManager and TransactionManager
clr.AddReference("RevitServices")
import RevitServices
from RevitServices.Persistence import DocumentManager
from RevitServices.Transactions import TransactionManager
clr.AddReference("RevitNodes")
import Revit
clr.ImportExtensions(Revit.GeometryConversion)
# Import RevitAPI
clr.AddReference("RevitAPI")
import Autodesk
from Autodesk.Revit.DB import *

doc = DocumentManager.Instance.CurrentDBDocument
uiapp = DocumentManager.Instance.CurrentUIApplication
app = uiapp.Application

from System.Collections.Generic import *

#Custom tolist definition provided by Dimitar Venkov
#https://github.com/dimven/SpringNodes
def tolist(x):
	if hasattr(x,'__iter__'): return x
	else : return [x]

elements = tolist(UnwrapElement(IN[0]))
views = tolist(UnwrapElement(IN[1]))
boundingBox = []

flag = 0;		
while flag < len(elements):
	element = elements[flag]
	view = views[flag]
	boundingBox.append(element.BoundingBox[view].ToProtoType())
	flag = flag + 1

OUT = boundingBox
# ----------------------------------------

# group: The element to check
select_model_element = DSModelElementSelection()  # 1 picked in the model
getLocation = Element.GetLocation(select_model_element)

contains = BoundingBox.Contains(python_script_2, getLocation)
