# Dynamo custom node Room.GetByNumber.dyf (Dynamo 1.3.2.2480)
# category: DynamoWorkshop.Revit.Elements.Room
# This will retrieve a room given it's number

roomNumber = Input(roomNumber : string)  # The room number to retrieve a Revit room with

# group: This builds the dictionary and grabs elements from it based on a key. In our case this will be room name.
categories = Categories("Rooms")
all_elements_of_category = ElementsOfCategory(categories)
code_block = CodeBlock { "Number"; }
getParameterValueByName = Element.GetParameterValueByName(element=all_elements_of_category, parameterName=code_block)
code_block_2 = CodeBlock(roomNumbers=all_elements_of_category, rooms=getParameterValueByName) { roomDictionary = {}; roomDictionary[roomNumbers] = rooms; }
code_block_3 = CodeBlock(roomDic=code_block_2.roomDictionary, key=roomNumber) { roomDic[key]; }

room = Output(code_block_3)
