# Dynamo graph 04.3_DataVisualization_End.dyn (Dynamo 1.3.1.1736)

# group: INPUT
# note: INPUT
# note: USE:
# FOR THE USER INPUT (SUCH AS SLIDERS,
#  NUMBERS, CODE BLOCKS....)

# group: DESIGN
# note: DESIGN
# note: USE:
# FOR THE BACK-END FUNCTIONALITY

# group: OUTPUT
# note: OUTPUT
# note: USE:
# FOR THE GRAPH OUTPUTS (SUCH AS CSV'S, CHARTS....)

# group: Get Rooms, Room Name, Number, and Area
categories = Categories("Rooms")
all_elements_of_category = ElementsOfCategory(categories)
name = Room.Name(all_elements_of_category)
area = Room.Area(all_elements_of_category)
number = Room.Number(all_elements_of_category)

# group: Grab Max and Min Areas to set Domain
minimumItem = List.MinimumItem(area)
maximumItem = List.MaximumItem(area)
domain = Charts.MiscNodes.Domain(minimumItem, maximumItem)

code_block = CodeBlock { Color.ByARGB(1, 105, 244, 189); }
margins_size = IntegerSlider(100, range=0..100 step 1)

# group: Creating Margins around Chart
margins = Charts.MiscNodes.Margins(margins_size, margins_size, margins_size, margins_size)

code_block_2 = CodeBlock { "Area"; }

# group: Setting X-axis Properties
count = Count(all_elements_of_category)
code_block_3 = CodeBlock { 90; }

# group: Create a Bar Chart with Data and Style Inputs
data = Charts.BarChart.Data(name, area, domain)
style = Charts.BarChart.Style(code_block, arg3=margins, arg6=code_block_2, arg7=count, arg8=code_block_3)
chart = Charts.BarChart.Chart(data, style)

# group: Select Categories of Elements to check if within room
categories_2 = Categories("Furniture")
all_elements_of_category_2 = ElementsOfCategory(categories_2)
categories_3 = Categories("Doors")
all_elements_of_category_3 = ElementsOfCategory(categories_3)
categories_4 = Categories("Windows")
all_elements_of_category_4 = ElementsOfCategory(categories_4)
create = List.Create(all_elements_of_category_2, all_elements_of_category_3, all_elements_of_category_4)
flatten = Flatten(create)

# group: Removing Elements that are not in a Room
room = Custom[Element.Room](element=flatten)  # This node takes the input of all elements of category and reports back the associated room per element. Currently tested with casework, furniture and plumbing fixtures.
isNull = Object.IsNull(room)
filterByBoolMask = List.FilterByBoolMask(list=room, mask=isNull)

# group: Group Elements by Room Name
name_2 = Room.Name(filterByBoolMask.out)
groupByKey = List.GroupByKey(list=filterByBoolMask.out, keys=name_2)

# group: Grab Max and Min Number of Elements in a Room to set Domain
count_2 = Count(groupByKey.groups@L2)
minimumItem_2 = List.MinimumItem(count_2)
maximumItem_2 = List.MaximumItem(count_2)
domain_2 = Charts.MiscNodes.Domain(minimumItem_2, maximumItem_2)

code_block_4 = CodeBlock { Color.ByARGB(1, 49, 149, 137); }
margins_size_2 = IntegerSlider(100, range=0..100 step 1)

# group: Creating Margins around Chart
margins_2 = Charts.MiscNodes.Margins(margins_size_2, margins_size_2, margins_size_2, margins_size_2)

code_block_5 = CodeBlock { "Element Count"; }

# group: Setting X-axis Properties
count_3 = Count(groupByKey.unique_keys)
code_block_6 = CodeBlock { 90; }

# group: Create a Bar Chart with Data and Style Inputs
data_2 = Charts.BarChart.Data(groupByKey.unique_keys, count_2, domain_2)
style_2 = Charts.BarChart.Style(code_block_4, arg3=margins_2, arg6=code_block_5, arg7=count_3, arg8=code_block_6)
chart_2 = Charts.BarChart.Chart(data_2, style_2)

# group: Get Rooms and Room Locations
categories_5 = Categories("Rooms")
all_elements_of_category_5 = ElementsOfCategory(categories_5)
location = Room.Location(all_elements_of_category_5)

# group: Shoot a ray up to find the object above the room (either ceiling or deck above)
ZAxis = Vector.ZAxis()
code_block_7 = CodeBlock { 1; }
views = Views("{3D}")
byOriginDirection = Revit.References.RayBounce.ByOriginDirection(location, ZAxis, code_block_7, views)

# group: Get only Rooms with Ceilings above
getCategory = Element.GetCategory(byOriginDirection.out1)
flatten_2 = Flatten(getCategory)
string_from_object = FromObject(flatten_2)
categories_6 = Categories("Ceilings")
string_from_object_2 = FromObject(categories_6)
eq = string_from_object == string_from_object_2
filterByBoolMask_2 = List.FilterByBoolMask(list=all_elements_of_category_5, mask=eq)
name_3 = Room.Name(filterByBoolMask_2.in)
filterByBoolMask_3 = List.FilterByBoolMask(list=byOriginDirection.out1, mask=eq)

# group: Grab Ceiling Heights
code_block_8 = CodeBlock { "Height Offset From Level"; }
getParameterValueByName = Element.GetParameterValueByName(element=filterByBoolMask_3.in, parameterName=code_block_8)
flatten_3 = Flatten(getParameterValueByName)

extend_domain = IntegerSlider(3, range=1..4 step 1)

# group: Grab Max and Min Ceiling Heights to set Domain
minimumItem_3 = List.MinimumItem(flatten_3)
maximumItem_3 = List.MaximumItem(flatten_3)
code_block_9 = CodeBlock(minCeilingHeight=minimumItem_3, domainbuffer=extend_domain, maxCeilingHeight=maximumItem_3) { minCeilingHeight - domainbuffer; maxCeilingHeight + domainbuffer; }
domain_3 = Charts.MiscNodes.Domain(code_block_9.out0, code_block_9.out1)

code_block_10 = CodeBlock { Color.ByARGB(1, 52, 77, 108); }
margins_size_3 = IntegerSlider(100, range=0..100 step 1)

# group: Creating Margins around Chart
margins_3 = Charts.MiscNodes.Margins(margins_size_3, margins_size_3, margins_size_3, margins_size_3)

code_block_11 = CodeBlock { "Ceiling Heights"; }

# group: Set Number of Room Ceiling Heights to add to Chart
count_4 = Count(filterByBoolMask_2.in)

code_block_12 = CodeBlock { 90; }

# group: Create a Bar Chart with Data and Style Inputs
data_3 = Charts.BarChart.Data(name_3, flatten_3, domain_3)
style_3 = Charts.BarChart.Style(code_block_10, arg3=margins_3, arg6=code_block_11, arg7=count_4, arg8=code_block_12)
chart_3 = Charts.BarChart.Chart(data_3, style_3)

# group: Create Reports
create_report = MandrillReportNode(chart, chart_2, chart_3)
report_window = MandrillWindowNodeModel(create_report)
