# Dynamo graph 05.1_Animation_End.dyn (Dynamo 1.3.2.2480)

# group: Dynamo Workshop- Animate Door Parameters.
# note: </Title>
# note: <Title>

# group: Control
# note: For sliders and other options

# group: To Revit
# note: For changes made to Revit

# group: Annotation
# note: For notes and titles

# group: Input
# note: For selection and whatnot

# group: Background
# note: For workflow

# group: Family types and parameter values
family_types = FamilyTypes("08 1100_Operable-Door_Single:HM 3'-0\" x 7'-0\"")
all_elements_of_family_type = ElementsOfFamilyType(family_types)
code_block = CodeBlock { "3D Swing Angle"; 0; 90; 20; }
string = StringInput("\\prlx2\Marketing\Lectures\2018- AULondon-IntermediateDynamoWorkshop\AU-Dynamo-Workshops\AU2018-London-Intermediate-Dynamo-Workshop\05_AnimationStrategiesWithDynamo\Images\Doors\")

activeView = Custom[Springs.Doc.ActiveView]()  # Selects the current document's active view. Supports more view types than the built-in option. Will be depreciated once the bult in node works with all plan types.
animateNumericParameter = Rhythm.Revit.Tools.Element.AnimateNumericParameter(all_elements_of_family_type, code_block.out0, code_block.out1, code_block.out2, code_block.out3, string, activeView)
