# Dynamo graph 05.2_Animation_End.dyn (Dynamo 1.3.2.2480)

# group: Dynamo Workshop- Animate Curtain Panel Color In View
# note: </Title>
# note: <Title>

# group: Control
# note: For sliders and other options

# group: To Revit
# note: For changes made to Revit

# group: Annotation
# note: For notes and titles

# group: Input
# note: For selection and whatnot

# group: Background
# note: For workflow

# group: Choose View to Export
views = Views("ExportView")

# group: Select curtain wall in model.
select_model_element = DSModelElementSelection()  # 1 picked in the model
byElement = CurtainPanel.ByElement(select_model_element)
asFamilyInstance = CurtainPanel.AsFamilyInstance(byElement)

# group: Colors to use as start and end
color_picker = nColorPicker()
color_picker_2 = nColorPicker()
create = List.Create(color_picker, color_picker_2)

# group: Builds the color range to override panels
count = Count(asFamilyInstance)
code_block = CodeBlock(panels=count) { 0..1..#panels; }
color_range = ColorRange(create, arg2=code_block)  # unwired: arg1

# group: Option Number
integer_slider = IntegerSlider(1, range=1..10 step 1)

# group: Randomizes order and builds color settings for each one.
randomizeOrder = Lists.Manage.RandomizeOrder(color_range, integer_slider)
fill_patterns = FillPatterns("Solid fill")
byProperties = Revit.Filter.OverrideGraphicSettings.ByProperties(arg1=randomizeOrder, arg5=fill_patterns)

# group: Override in active view.
overrideInView = Element.OverrideInView(element=asFamilyInstance, overrides=byProperties)

passthrough = Custom[Passthrough](passThrough=views, waitFor=overrideInView)  # Forces a sequential order of execution. The node wired into the output of the Passthrough node will be executed *after* the node wired into the waitFor input (e.g. important for some Revit operations). The value of the passThrough input will be passed on to the node wired into the output port of the Passthrough node.
string = StringInput("D:\OneDrive\EvolveLAB Transfer\EvolveLAB\Presentations\AU2017\Dynamo BIM Workshop\Dataset\05_AnimationStrategiesWithDynamo\Images\ColorFacade")
code_block_2 = CodeBlock(path=string, number=integer_slider) { path+"\\"+number+".png"; }
exportAsImage = View.ExportAsImage(passthrough, code_block_2)
