# Dynamo graph 05.3_Animation_End.dyn (Dynamo 1.3.2.2480)

# group: Background
# note: For workflow

# group: Input
# note: For selection and whatnot

# group: Control
# note: For sliders and other options

# group: To Revit
# note: For changes made to Revit

# group: Annotation
# note: For notes and titles

# group: Dynamo Workshop- Animate Curtain Panel Materials
# note: <Title>
# note: </Title>

views = Views("ExportView")

# group: Get curtain panels from wall
select_model_element = DSModelElementSelection()  # 1 picked in the model
byElement = CurtainPanel.ByElement(select_model_element)
asFamilyInstance = CurtainPanel.AsFamilyInstance(byElement)

# group: Find the random panels in the file to use.
element_types = ElementTypes("FamilySymbol")
all_elements_of_type = ElementsOfType(element_types)
name = Element.Name(all_elements_of_type)
code_block = CodeBlock { "Random"; }
startsWith = String.StartsWith(str=name, searchFor=code_block)
filterByBoolMask = List.FilterByBoolMask(list=all_elements_of_type, mask=startsWith)

# group: Cycle the list a bunch of times to have enough of these things.
count = Count(asFamilyInstance)
cycle = List.Cycle(list=filterByBoolMask.in, amount=count)

# group: The option number
integer_slider = IntegerSlider(1, range=1..10 step 1)

# group: Randomize and take the amount you need
randomizeOrder = Lists.Manage.RandomizeOrder(cycle, integer_slider)
takeItems = List.TakeItems(list=randomizeOrder, amount=count)

# group: Set the new option
# note: Wombat
setType = WombatDynamo.FamilyInstance.SetType(asFamilyInstance, takeItems)

passthrough = Custom[Passthrough](passThrough=views, waitFor=setType)  # Forces a sequential order of execution. The node wired into the output of the Passthrough node will be executed *after* the node wired into the waitFor input (e.g. important for some Revit operations). The value of the passThrough input will be passed on to the node wired into the output port of the Passthrough node.

# group: Build path
string = StringInput("\\prlx2\Marketing\Lectures\2018- AULondon-IntermediateDynamoWorkshop\AU-Dynamo-Workshops\AU2018-London-Intermediate-Dynamo-Workshop\05_AnimationStrategiesWithDynamo\Images\RandomMaterial")
code_block_2 = CodeBlock(path=string, number=integer_slider) { path+"\\"+number+".png"; }

exportAsImage = View.ExportAsImage(passthrough, code_block_2)
