# Dynamo graph 05.5_BONUS-generativeBIMZ.dyn (Dynamo 1.3.2.2480)

number_slider = DoubleSlider(17, range=0..50 step 1)
code_block = CodeBlock { 150; }
byOrigin = CoordinateSystem.ByOrigin(code_block, code_block)
code_block_2 = CodeBlock { Flatten({20,45,15,100,80}); }
code_block_3 = CodeBlock { 0; 4; 10000; }
faderOneWay = Firefly.Utility.FaderOneWay(code_block_3.out0, code_block_3.out1, code_block_3.out2)
ceiling = Math.Ceiling(faderOneWay)
getItemAtIndex = List.GetItemAtIndex(list=code_block_2, index=ceiling)
code_block_4 = CodeBlock { 100; 40; }
byWidthLength = Rectangle.ByWidthLength(cs=byOrigin, width=getItemAtIndex, length=code_block_4.out1)
byPatch = Surface.ByPatch(byWidthLength)
code_block_5 = CodeBlock { 10; 5; }
panelQuad = Geometry.Panel.PanelQuad(byPatch, code_block_5.out0, code_block_5.out1)
code_block_6 = CodeBlock { 0; 50; 10000; }
faderOneWay_2 = Firefly.Utility.FaderOneWay(code_block_6.out0, code_block_6.out1, code_block_6.out2)
ceiling_2 = Math.Ceiling(faderOneWay_2)
takeItems = List.TakeItems(list=panelQuad, amount=ceiling_2)
code_block_7 = CodeBlock { 5; }
code_block_8 = CodeBlock { false; }
thicken = Surface.Thicken(surface=takeItems, thickness=code_block_7, both_sides=code_block_8)
code_block_9 = CodeBlock { 1; 10; 20000; 20000; }
faderOneWay_3 = Firefly.Utility.FaderOneWay(code_block_9.out0, code_block_9.out1, code_block_9.out2, code_block_9.out3)
ceiling_3 = Math.Ceiling(faderOneWay_3)
code_block_10 = CodeBlock(floors=ceiling_3) { 5..#floors..5; }
translate = Geometry.Translate(geometry=thicken@L1, zTranslation=code_block_10)
color_picker = nColorPicker()
color_picker_2 = nColorPicker()
color_picker_3 = nColorPicker()
create = List.Create(color_picker, color_picker_2, color_picker_3)
code_block_11 = CodeBlock { 50; }
cycle = List.Cycle(list=create, amount=code_block_11)
shuffle = List.Shuffle(cycle)
byGeometryColor = Display.Display.ByGeometryColor(translate, shuffle)
